# Grasshopper definition 121018MyceliumGrowthbylogichoopsnake.gh (Grasshopper 0.9.75)
# plug-ins: HoopSnake

# ---- group: Food Field Base Point
slider = Slider(0, range=0..100)
pt = PointXYZ(XComponent=slider, YComponent=slider, ZComponent=slider, System=PlaneXY(0, 0, 0))

# ---- group: Food Points
slider_2 = Slider(10000, range=0..10000)
rectangle = Rectangle(Plane=pt, XSize=slider_2, YSize=slider_2, Radius=0)  # -> Rectangle, Length
pop2d = Populate2D(Region=rectangle.Rectangle, Count=Slider(7226, range=0..10000), Seed=1)

# ---- group: Spore Points and Branching Options
branches_no = Slider(2, range=0..10)
food_reach = Slider(332, range=0..10000)
spore_a = Slider(4537, range=0..10000)
spore_b = Slider(5038, range=0..10000)
pt_2 = Point(pop2d)
item = ListItem(List=pt_2, Index=spore_a, Wrap=False)

# ----
spore_d = Slider(2785, range=0..10000)
spore_c = Slider(1044, range=0..10000)

# ---- group: Hoopsnake Food Searching Process
mycelium = Mycelium2(food_source=pt_2, start_point=item, searching_distance=food_reach, max_branches=branches_no)  # -> remaining_food, endpoints, branch_line
entwine = Entwine(Branch00=mycelium.remaining_food, Branch01=mycelium.endpoints, Branch02=mycelium.branch_line)
entwine_2 = Entwine(Branch00=mycelium_2.remaining_food, Branch01=mycelium_2.endpoints, Branch02=mycelium_2.branch_line)
hs = HoopSnake(
    StartingData=entwine,
    Data=entwine_2,
    Hoopsnake_Data_autoUpdate=False,
    Hoopsnake_Data_dataLimit=2147483647,
    Hoopsnake_Data_delay=0,
    Hoopsnake_Data_resetCounter=True,
    Hoopsnake_Data_updateView=True)  # -> Feedback, FeedbackHistory, LoopsCounter, IterationsCounter
path_mapper = PathMapper(hs.FeedbackHistory, source="[a;b]", target="[b]")
bang = ExplodeTree(Data=hs.Feedback)  # -> Branch0, Branch1, Branch2
mycelium_2 = Mycelium2(food_source=bang.Branch0, start_point=bang.Branch1, searching_distance=food_reach, max_branches=branches_no)  # -> remaining_food, endpoints, branch_line
bang_2 = ExplodeTree(Data=path_mapper)  # -> Branch0, Branch1, Branch2

# ---- group: Output Fungi Lines
geo = Geometry(bang_2.Branch2)

# ==== cluster Mycelium2: Grows towards the closest food source [pts] within reach of starting point. Plug end psts into start points and food left into food in to create a branching chain

# ---- group: Input
food_source = ClusterInput()
start_point = ClusterInput()
max_branches = ClusterInput()
searching_distance = ClusterInput()

# ---- group: Move towards closest reachable food source
pt = Point(graft(start_point))
pt_2 = Point(food_source)
cps = ClosestPoints(Point=pt, Cloud=pt_2, Count=max_branches)  # -> ClosestPoint, CPIndex, Distance
smaller = SmallerThan(FirstNumber=cps.Distance, SecondNumber=searching_distance)  # -> SmallerThan, OrEqualTo
dispatch = Dispatch(List=cps.ClosestPoint, DispatchPattern=smaller.OrEqualTo)  # -> ListA, ListB
ln = Line(StartPoint=pt, EndPoint=dispatch.ListA)  # -> flatten(Line)

# ---- group: Cull eaten food
cp = ClosestPoint(Point=dispatch.ListA, Cloud=pt_2)  # -> ClosestPoint, flatten(CPIndex), Distance
cull_i = CullIndex(List=pt_2, Indices=cp.CPIndex, Wrap=False)
pt_3 = Point(cull_i)

# ---- group: Remove two feeding from same food
end = EndPoints(Curve=ln)  # -> Start, End
cullpt = CullDuplicates(Points=end.End, Tolerance=Slider(1, range=0..1), CullMode=3)  # -> Points, Indices, Valence
cps_2 = ClosestPoints(Point=cullpt.Points, Cloud=end.End, Count=1)  # -> ClosestPoint, flatten(CPIndex), Distance
slider = Slider(0.5, range=0..1)
cull_i_2 = CullIndex(List=ln, Indices=cps_2.CPIndex, Wrap=True)
eval = EvaluateCurve(Curve=cull_i_2, Parameter=slider)  # -> Point, Tangent, Angle
eval_2 = EvaluateCurve(Curve=ln, Parameter=slider)  # -> Point, Tangent, Angle
fsim = FindSimilarMember(Data=eval.Point, Set=eval_2.Point)  # -> Hit, Index
cull_i_3 = CullIndex(List=ln, Indices=fsim.Index, Wrap=False)
line = Line(cull_i_3)
end_2 = EndPoints(Curve=line)  # -> Start, End

# ---- group: Outputs
remaining_food = ClusterOutput(pt_3)
endpoints = ClusterOutput(end_2.End)
branch_line = ClusterOutput(line)
