# Grasshopper definition SpaceColonizationAlgorithm.gh (Grasshopper 0.9.75)

md_slider = MDSlider(
    slider_value=Point(0.3719512195, 0.6280487805, 0.5),
    SliderMode=0,
    x_domain=Domain(0, 15),
    y_domain=Domain(0, 15),
    z_domain=Domain(0, 1))
pop2d = Populate2D(Region={Plane=PlaneXY(0, 0, 0), Size=Domain2(u=0..15, v=0..15)}, Count=100, Seed=1)
cir = Circle(Plane=pop2d, Radius=0.25)
pt = Point(md_slider)
c_script = CSharpScript(Food=cir, Origin=pt)  # -> Out, A
