# Grasshopper definition SpaceColonizationAlgorithm_3D_donkey_1.gh (Grasshopper 0.9.75)
# plug-ins: Donkey

md_slider = MDSlider(slider_value=Point(1, 1, 0.5), SliderMode=0, x_domain=Domain(0, 15), y_domain=Domain(0, 15), z_domain=Domain(0, 1))
md_slider_2 = MDSlider(slider_value=Point(0, 0, 0.5), SliderMode=0, x_domain=Domain(0, 15), y_domain=Domain(0, 15), z_domain=Domain(0, 1))
distance_step = Slider(0.5, range=0.5..10)
influence_distance = Slider(5, range=1..5)
kill_eat_distance = Slider(1, range=1..2)
Z = Slider(11, range=0..15)
iteration = Slider(30, range=0..50)
number_slider = Slider(0.1, range=0..1)
pop3d = Populate3D(Region={Plane=PlaneXY(0, 0, 0), X=Domain(0, 15), Y=Domain(0, 15), Z=Domain(0, 15)}, Count=100, Seed=1)
pop3d_2 = Populate3D(
    Region={Plane=PlaneXY(0, 0, 0), X=Domain(0, 15), Y=Domain(0, 15), Z=Domain(0, 15)},
    Count=100,
    Seed=Slider(5, range=0..10))
profile = Profile(Width=number_slider, Height=number_slider, profile_id=2)
cluster = Cluster(pt=md_slider, B=md_slider, G=md_slider_2, F=Z)
item = ListItem(List=cluster, Index=1, Wrap=True)
support = NodalSupport(Node=item)
sc = SpaceColonization(
    Food=[pop3d, pop3d_2],
    Origin=item,
    Step=distance_step,
    Infuence=influence_distance,
    KillEat=kill_eat_distance,
    Iteraction=iteration,
    Reset=Button())
sc_2 = SpaceColonization(food=[pop3d, pop3d_2], origin=item, D=distance_step, di=influence_distance, dk=kill_eat_distance, loop=iteration)  # -> out, A, B, C; inputs food: list of Point3d, origin: list of Point3d, D: Double, di: Double, dk: Double, loop: Int32
# ---------- sc_2: C# ----------
    Particle.Field = new List<Particle>();
    foreach(Point3d pt in origin)
      Particle.Create(pt);
    Particle.step_size = D;
    Particle.eatable_distance = D * dk;
    Particle.infuence_distance = D * di;

    while(loop > 0)
    {
      for(int i = food.Count() - 1 ; i >= 0; i--)
      {
        // if food is eatable
        if(Particle.IsEatable(food[i]))
        {
          food.RemoveAt(i); // eat it
          Print("food at index " + i + " was removed");
        }
      }
      Particle.Move();
      loop--;
    }

    A = food;
    B = Particle.Positions();
    C = Particle.Connections();
# ---------- sc_2: C# additional code ----------
  public class Particle
  {
    //STATIC FIELD
    static public double eatable_distance = 1; //HACK multipy D
    static public double infuence_distance = 5;
    static public double step_size = 1; //D as distance
    static public List<Particle> Field = new List<Particle>(); //HACK properties get only

    //STATIC METHODS
    static public void Create(Point3d position)
    {
      Field.Add(new Particle(position));
    }

    static public bool IsEatable(Point3d food)
    {
      //find closest particle to food
      double closest_distance = double.MaxValue;
      int x = -1;

      for(int i = 0; i < Field.Count(); i++)
      {
        //FIND CLOSEST PARTICLE FOR THE FOOD
        double actual_distance = food.DistanceTo(Particle.Field[i].Position);
        if(actual_distance < closest_distance)
        {
          x = i;
          closest_distance = actual_distance;
        }
      }
      //===: closest particle is particle with index x in the field


      //if food is too close - eat it, otherwise target it
      if(closest_distance <= eatable_distance)
        return true;
      else
      {
        if(closest_distance <= infuence_distance)
          Field[x].TargetFood(food); //prepare to move
        return false;
      }
    }

    static public void Move()
    {
      List<Particle> temp_field = new List<Particle>();
      for(int p = 0; p < Field.Count(); p++)
      {
        Particle clone = Field[p].Clone();
        if(clone != null)
          temp_field.Add(clone);
      }
      Field.AddRange(temp_field);
    }

    static public List<Point3d> Positions()
    {
      List<Point3d> positions = new List<Point3d>(Field.Count());
      for(int p = 0; p < Field.Count();p++)
      {
        positions.Add(Field[p].Position);
      }
      return positions;
    }

    static public List<Line> Connections()
    {
      List<Line> connections = new List<Line>(Field.Count());
      for(int p = 0; p < Field.Count();p++)
      {
        if(Field[p].connection != Line.Unset)
          connections.Add(Field[p].connection);
      }
      return connections;
    }


    //***************************************************************************

    //FIELD
    Point3d position;
    Vector3d direction;
    public Line connection;

    //CONSTRUCTOR
    Particle(Point3d position)
    {
      this.position = position;
      this.direction = Vector3d.Zero;
      this.connection = Line.Unset;
    }

    Particle(Point3d position, Vector3d vector)
    {
      this.position = position + vector;
      this.direction = Vector3d.Zero;
      this.connection = new Line(this.position, position);
    }

    //PROPERTIES
    public Point3d Position
    {
      get{ return this.position;}
    }


    //METHODS
    void TargetFood(Point3d food)
    {
      Vector3d food_direction = food - this.position;
      //food_direction.Unitize(); //NORMAL VECTOR?
      this.direction += food_direction;
      this.direction.Unitize();
    }

    Particle Clone()
    {
      if(this.direction != Vector3d.Zero)
      {
        Particle clone = new Particle(this.position, (this.direction * step_size));
        this.direction = Vector3d.Zero;
        return clone;
      }
      else
        return null;
    }
  }
# ---------- end sc_2 ----------
number_slider_2 = Slider(0, range=0..100)
pt = Point(sc_2.B)
cir = Circle(Plane=sc_2.A, Radius=0.25)
panel = Panel(sc_2.out)
geo = Geometry(sc)
scale = Scale(Geometry=geo, Center=item, Factor=Slider(100, range=0..100))  # -> Geometry, Transform
beam = Beam(Geometry=scale.Geometry, Profile=profile, dummy=False)
model = Model(ElementS=flatten(beam), Conditions=flatten(support), remove_geometry_duplicates=True, remove_node_duplicates=True)
analysis = Analysis(
    Model=model,
    Name="140612",
    analysis_arguments="""-IN_meshGen_elemSize 500.0
-IN_meshGen_elemCount 10
-P_RigidBodyToRigidArm
-P_solverOOFEM -
-P_dw
//-P_stability
-IO_ff vtu
-OUT_print_CSusage
-OUT_moBFN -
-OUT_print_model_parent
-OUT_print_property
//-OUT_args""",
    analysis_IsLocal_arguments=False,
    analysis_IsLocal_MIDASpath=False,
    analysis_IsLocal_WorkingDirectory=False,
    analysis_MIDASpath="C:\MIDAS\midas.exe",
    analysis_popup=False,
    analysis_workingDirectory="C:\MIDAS\Polygone_Normal")
efficiency = Efficiency(Result=analysis, preview_data=False)
displacement = Displacement(Result=analysis, Scale=1)
stability = Stability(Result=analysis)
elements = ElementsValues(Result=analysis)
bnd = Bounds(Numbers=elements)
remap = RemapNumbers(Value=elements, Source=bnd, Target=Domain(0.1, 1))  # -> Mapped, Clipped
number_slider_3 = Slider(15, range=0..100)
pipeline = GeometryPipeline(
    GroupByLayer=False,
    GroupByType=False,
    IncludeHidden=True,
    IncludeLocked=True,
    LayerFilter="add_lines",
    NameFilter="*",
    TypeFilter=4)  # disabled
graph = GraphMapper(remap.Mapped, x0=0, x1=1, y0=0, y1=1, container_name="Conic", Cx=0.1252007931, Cy=0.4272146821)
profile_2 = Profile(Width=number_slider_3, Height=number_slider_3, profile_id=2)
multiplication = Multiplication(A=Slider(15, range=0..100), B=graph)
num = Number(multiplication)
profile_3 = Profile(Width=num, Height=num, profile_id=2)
beam_2 = Beam(Geometry=pipeline, Profile=profile_2, dummy=False)  # disabled
pipe = Pipe(Curve=scale.Geometry, Radius=multiplication, Caps=2)
beam_3 = Beam(Geometry=flatten(scale.Geometry), Profile=flatten(profile_3), dummy=False)
model_2 = Model(
    ElementS=flatten([beam_3, beam_2]),
    Conditions=flatten(support),
    remove_geometry_duplicates=True,
    remove_node_duplicates=True)
analysis_2 = Analysis(
    Model=model_2,
    Name="140612_A",
    analysis_arguments="""-IN_meshGen_elemSize 500.0
-IN_meshGen_elemCount 10
-P_RigidBodyToRigidArm
-P_solverOOFEM -
-P_dw
//-P_stability
-IO_ff vtu
-OUT_print_CSusage
-OUT_moBFN -
-OUT_print_model_parent
-OUT_print_property
//-OUT_args""",
    analysis_IsLocal_arguments=False,
    analysis_IsLocal_MIDASpath=False,
    analysis_IsLocal_WorkingDirectory=False,
    analysis_MIDASpath="C:\MIDAS\midas.exe",
    analysis_popup=False,
    analysis_workingDirectory="C:\MIDAS\Polygone_Normal")
efficiency_2 = Efficiency(Result=analysis_2, preview_data=False)
displacement_2 = Displacement(Result=analysis_2, Scale=1)

# ==== cluster Cluster
F = ClusterInput()
G = ClusterInput()
Z = UnitZ(Factor=F)
move = Move(Geometry=G, Motion=Z)  # -> Geometry, Transform
pt = ClusterInput()
B = ClusterInput()
pt_2 = Point([move.Geometry, pt])
sph = Sphere(Base=[move.Geometry, B], Radius=0.5)
pt_3 = ClusterOutput(pt_2)
