# Grasshopper definition SpaceColonization_2.gh (Grasshopper 0.9.76)
# plug-ins: Space Colonization, Donkey v0.82

influence_distance = Slider(2.9, range=1..5)
kill_eat_distance = Slider(1, range=1..2)
distance_step = Slider(2, range=0.5..10)
iteration = Slider(10, range=0..50)
pipeline = GeometryPipeline(
    GroupByLayer=False,
    GroupByType=False,
    IncludeHidden=True,
    IncludeLocked=True,
    LayerFilter="*",
    NameFilter="*",
    TypeFilter=1)
pop3d = Populate3D(
    Region={Plane=PlaneXY(0, 0, 0), X=Domain(0, 15), Y=Domain(0, 15), Z=Domain(0, 15)},
    Count=Slider(500, range=100..500),
    Seed=Slider(0, range=0..10))
button = Button()
pipeline_2 = GeometryPipeline(
    GroupByLayer=False,
    GroupByType=False,
    IncludeHidden=True,
    IncludeLocked=True,
    LayerFilter="*",
    NameFilter="*",
    TypeFilter=4)
sc = SpaceColonization(
    Food=pop3d,
    Origin=pipeline,
    Step=distance_step,
    Infuence=influence_distance,
    KillEat=kill_eat_distance,
    Iteraction=iteration,
    Reset=Toggle(True))
splitting = SplittingCurves(Curve=flatten([pipeline_2, sc]))
branch = Branch(Geometry=splitting, ForceDensity=1, dummy=False)
topology = Topology(Branches=branch, FixedNodes=pipeline, SubDivide=0, gravitation=True)  # -> Out, P, O
int = Integer(topology.Out)
tag = TextTag3D(Location=topology.P, Text=int, Size=0.25, Justification=7)
